# Grasshopper definition 02_plugin_vpl.gh (Grasshopper 1.0.7)

# How to create a python plugin with Grasshopper
# part 2 - VPL script
# 
# VPL script with a conditional statement
# 
# Idea:
# User moves the footprint of building upon different lands and it will be extruded automatically.
# Extrusion has to follow planning rules of the selected land, in particular the FAR of each land.
# 
# 
# Definitions:
# FAR = Floor area ratio (FAR) is the ratio of a building's total floor area
# (gross floor area) to the size of the piece of land upon which it is built. (Wikipedia)
# 
# 
# Requirements:
# Gismo for visualization
# ShrimpGIS
gismo = Gismo_Gismo(gismoFolder="c:\gismo")  # -> readMe; plug-in component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

# ---- group: Location
panel = Panel("Larino")
panel_2 = Panel("41.806148")
# This is part of PNL project by Antonello Di Nunzio
# 
# plugin@antonellodinunzio.online
panel_3 = Panel("14.9164668")

# ---- group: Visualize the context
osmobjects = Gismo_OSMObjects({"Building", "Commercial building", "Residential building", "Office building", "Office administrative", "Office government", "Post office", "Hospital", "Ambulance station", "Pharmacy"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}, selected="Building")
osmkeys = Gismo_OSMKeys(OSMobjectName=osmobjects)  # -> readMe, requiredKeys, OSMwebpage; inputs OSMobjectName: list; plug-in component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
createlocation = Gismo_CreateLocation(locationName=panel, latitude=panel_2, longitude=panel_3)  # -> location; plug-in component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
osmshapes = Gismo_OSMShapes(location=createlocation, radius="800", shapeType=0, requiredKeys=osmkeys.requiredKeys, bakeIt=False, runIt=Toggle(True))  # -> readMe, shapes, keys, values, port, titleOriginPt, title; inputs radius: Int32, origin: Point3d, shapeType: Int32, requiredKeys: list, onlyRemove_Ids: tree, bakeIt: Boolean, runIt: Boolean; plug-in component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

# ---- group: Create a ShrimpGIS location
shrimp_location = ShrimpGISLocation(name=panel, latitude=panel_2, longitude=panel_3)  # -> location; inputs anchor_point: Point3d; plug-in component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

# ---- group: Replace with a dir path where to save shp
python = GhPythonScript()  # -> geojson
# ---------- python: Python ----------
"""Get current path - for examples only"""

__author__ = "antonellodinunzio"

import os
file_name = ghenv.Component.OnPingDocument().FilePath
geojson = os.path.join(os.path.dirname(file_name), "geojson\\polygon.json")
# ---------- end python ----------

# ---- group: 1
toggle = BooleanToggle(True)

# ---- group: Read geojson
shrimp_read_geojson = ShrimpGISReadGeojson(geojson_file=python, location=shrimp_location, run_it=toggle)  # -> read_me, field, type, geometry; inputs run_it: Boolean; plug-in component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

# ----
flatten = FlattenTree(Tree=shrimp_read_geojson.geometry, Path="{0}")
# FAR = gross floor area / area of the plot
panel_4 = Panel(flatten)

# ---- group: Take only the first
item = ListItem(List=flatten, Index=0, Wrap=True)  # -> Item, Item1

# ---- group: My footprint
crv = Curve(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)

# ----
floor_height = Panel("3")
area = Area(Geometry=crv)  # -> Area, Centroid

# ---- group: Plot A
bcx = BrepCurve(Brep=item.Item, Curve=crv)  # -> Curves, Points
max_height = Panel("18")
far_limit = Panel("2")
bool = Boolean(bcx.Curves)
merge = Merge(Data1=item.Item, Data2=far_limit, Data3=max_height)
filter = StreamFilter(Gate=bool, Stream1=merge)

# ----
bcx_2 = BrepCurve(Brep=item.Item1, Curve=crv)  # -> Curves, Points
max_height_2 = Panel("19")
far_limit_2 = Panel("1.5")
bool_2 = Boolean(bcx_2.Curves)
merge_2 = Merge(Data1=item.Item1, Data2=far_limit_2, Data3=max_height_2)
filter_2 = StreamFilter(Gate=bool_2, Stream1=merge_2)

item_2 = ListItem(List=[filter, filter_2], Index=0, Wrap=True)  # -> Item, Item1, Item2
area_2 = Area(Geometry=item_2.Item)  # -> Area, Centroid
multiplication = Multiplication(A=area_2.Area, B=item_2.Item1)

# ---- group: Calculate n. of floors
division = Division(A=multiplication, B=area.Area)
round = Round(Number=division)  # -> Nearest, Floor, Ceiling
panel_5 = Panel(round.Floor)

# ---- group: Floor array
series = Series(Start=0, Step=floor_height, Count=round.Floor)

# ---- group: Visualization part 1
Z = UnitZ(Factor=series)
move = Move(Geometry=crv, Motion=Z)  # -> Geometry, Transform
Z_2 = UnitZ(Factor=floor_height)
boundary = BoundarySurfaces(Edges=move.Geometry)
extr = Extrude(Base=move.Geometry, Direction=Z_2)
edges = BrepEdges(Brep=extr)  # -> Naked, Interior, NonManifold

# ---- group: Get the building height
addition = Addition(A=series, B=floor_height)  # -> reverse(Result)
item_3 = ListItem(List=addition, Index=0, Wrap=True)

# ---- group: Get the current FAR
multiplication_2 = Multiplication(A=area.Area, B=round.Floor)
division_2 = Division(A=multiplication_2, B=area_2.Area)

# ---- group: is the height less than max height of the land?
smaller = SmallerThan(FirstNumber=item_3, SecondNumber=item_2.Item2)  # -> SmallerThan, OrEqualTo

# ---- group: is the FAR less than max FAR of the land?
smaller_2 = SmallerThan(FirstNumber=division_2, SecondNumber=item_2.Item1)  # -> SmallerThan, OrEqualTo

# ----
and = GateAnd(A=smaller.OrEqualTo, B=smaller_2.OrEqualTo)

panel_6 = Panel(and)

# ---- group: Color property
filter_3 = StreamFilter(Gate=and, Stream0=ColourSwatch(SwatchColor=RGB(171, 94, 94)), Stream1=ColourSwatch(SwatchColor=RGB(132, 171, 94)))
preview = CustomPreview(Geometry=boundary, Material=filter_3)
