# Grasshopper definition 03_plugin_functional_python.gh (Grasshopper 1.0.7)

# How to create a python plugin with Grasshopper
# part 3 - python script
# 
# Focus on a functional script to replicate VPL behavior
# 
# Idea:
# User moves the footprint of building upon different lands and it will be extruded automatically.
# Extrusion has to follow planning rules of the selected land, in particular the FAR of each land.
# 
# 
# Definitions:
# FAR = Floor area ratio (FAR) is the ratio of a building's total floor area
# (gross floor area) to the size of the piece of land upon which it is built. (Wikipedia)
# 
# 
# Requirements:
# Gismo for visualization
# ShrimpGIS
gismo = Gismo_Gismo(gismoFolder="c:\gismo")  # -> readMe; plug-in component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

# ---- group: Location
panel = Panel("Larino")
panel_2 = Panel("41.806148")
# This is part of PNL project by Antonello Di Nunzio
# 
# plugin@antonellodinunzio.online
panel_3 = Panel("14.9164668")

# ---- group: Visualize the context
osmobjects = Gismo_OSMObjects({"Building", "Commercial building", "Residential building", "Office building", "Office administrative", "Office government", "Post office", "Hospital", "Ambulance station", "Pharmacy"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}, selected="Building")
osmkeys = Gismo_OSMKeys(OSMobjectName=osmobjects)  # -> readMe, requiredKeys, OSMwebpage; inputs OSMobjectName: list; plug-in component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
createlocation = Gismo_CreateLocation(locationName=panel, latitude=panel_2, longitude=panel_3)  # -> location; plug-in component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
osmshapes = Gismo_OSMShapes(location=createlocation, radius="800", shapeType=0, requiredKeys=osmkeys.requiredKeys, bakeIt=False, runIt=Toggle(True))  # -> readMe, shapes, keys, values, port, titleOriginPt, title; inputs radius: Int32, origin: Point3d, shapeType: Int32, requiredKeys: list, onlyRemove_Ids: tree, bakeIt: Boolean, runIt: Boolean; plug-in component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

# ---- group: Create a ShrimpGIS location
shrimp_location = ShrimpGISLocation(name=panel, latitude=panel_2, longitude=panel_3)  # -> location; inputs anchor_point: Point3d; plug-in component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

# ---- group: Replace with a dir path where to save shp
python = GhPythonScript()  # -> geojson
# ---------- python: Python ----------
"""Get current path - for examples only"""

__author__ = "antonellodinunzio"

import os
file_name = ghenv.Component.OnPingDocument().FilePath
geojson = os.path.join(os.path.dirname(file_name), "geojson\\polygon.json")
# ---------- end python ----------

# ---- group: 1
toggle = BooleanToggle(True)

# ---- group: Read geojson
shrimp_read_geojson = ShrimpGISReadGeojson(geojson_file=python, location=shrimp_location, run_it=toggle)  # -> read_me, field, type, geometry; inputs run_it: Boolean; plug-in component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

# ----
flatten = FlattenTree(Tree=shrimp_read_geojson.geometry, Path="{0}")
# FAR = gross floor area / area of the plot
panel_4 = Panel(flatten)

# ---- group: Take only the first
item = ListItem(List=flatten, Index=0, Wrap=True)  # -> Item, Item1

# ---- group: Building
floor_height = Panel("3.2")
crv = Curve(<curve referenced from the Rhino model>)
area = Area(Geometry=crv)  # -> Area, Centroid

# ---- group: Plot A
bcx = BrepCurve(Brep=item.Item, Curve=crv)  # -> Curves, Points
max_height = Panel("18")
far_limit = Panel("2")
bool = Boolean(bcx.Curves)
merge = Merge(Data1=item.Item, Data2=far_limit, Data3=max_height)
filter = StreamFilter(Gate=bool, Stream1=merge)

# ----
bcx_2 = BrepCurve(Brep=item.Item1, Curve=crv)  # -> Curves, Points
max_height_2 = Panel("19")
far_limit_2 = Panel("1.5")
bool_2 = Boolean(bcx_2.Curves)
merge_2 = Merge(Data1=item.Item1, Data2=far_limit_2, Data3=max_height_2)
filter_2 = StreamFilter(Gate=bool_2, Stream1=merge_2)

crv_2 = Curve(<curve referenced from the Rhino model>)
floor_height_2 = Panel("3.2")
far_limit_3 = Panel("2")
max_height_3 = Panel("18")
python_2 = GhPythonScript(plot=item.Item, footprint=crv_2, floor_height=floor_height_2, far_limit=far_limit_3, max_height=max_height_3)  # -> out, floors, walls, check; inputs plot: Brep, footprint: Curve
# ---------- python_2: Python ----------
__author__ = "plugi"
__version__ = "2020.08.03"

# Here I import main module to use
import Rhino as rh
import math

# LIMITS
# Only polygon without holes

# tolerance
tol = 0.01

def get_floor_to_visualize(floor_surface, height_collection):
    
    floors = []
    for h in height_collection:
        z_move = rh.Geometry.Transform.Translation(0, 0, h)
        floor = floor_surface.Duplicate()
        floor.Transform(z_move)
        floors.append(floor)
    
    return floors

def get_wiframe_building(height, floors):
    
    vector = rh.Geometry.Vector3d(0, 0, height)
    
    wireframe = []
    
    for f in floors:
        curve = rh.Geometry.Curve.JoinCurves(f.DuplicateEdgeCurves(True))[0]
        wireframe.append(rh.Geometry.Surface.CreateExtrusion(curve, vector))
    
    return wireframe

def main():
    
    # footprint params
    footprint_area = rh.Geometry.AreaMassProperties.Compute(_footprint).Area
    
    # conditional statement to see if we can go ahead
    is_building_in_plot = rh.Geometry.Intersect.Intersection.CurveBrep(_footprint, _plot, tol)[1].Length > 0
    
    if (is_building_in_plot):
        
        # calculate plot area and max floor area you can build
        plot_area = rh.Geometry.AreaMassProperties.Compute(_plot).Area
        max_floor_area = plot_area * _far_limit
        
        # how many floor?
        number_of_floor = int(math.floor(max_floor_area / footprint_area))
        
        height_collection = [n * _floor_height for n in range(number_of_floor)]
        
        # visualization part
        floor_surface = rh.Geometry.Brep.CreatePlanarBreps(_footprint, tol)[0]
        
        floors = get_floor_to_visualize(floor_surface, height_collection)
        walls = get_wiframe_building(_floor_height, floors)
        
        # get the building height
        building_height = height_collection[-1] + _floor_height
        
        # get the current FAR
        current_far = (number_of_floor * footprint_area) / plot_area
        
        # check
        check = (building_height <= _max_height) and (current_far <= _far_limit)
        
        return floors, walls, check
    return [None] * 3

if _plot and _footprint and _floor_height and _far_limit and _max_height:
    floors, walls, check = main()
else:
    print("Please, connect all inputs")
# ---------- end python_2 ----------
item_2 = ListItem(List=[filter, filter_2], Index=0, Wrap=True)  # -> Item, Item1, Item2
panel_5 = Panel(python_2.out)

# ---- group: Color property
filter_3 = StreamFilter(
    Gate=python_2.check,
    Stream0=ColourSwatch(SwatchColor=RGB(171, 94, 94)),
    Stream1=ColourSwatch(SwatchColor=RGB(132, 171, 94)))
preview = CustomPreview(Geometry=python_2.floors, Material=filter_3)

# ----
area_2 = Area(Geometry=item_2.Item)  # -> Area, Centroid
multiplication = Multiplication(A=area_2.Area, B=item_2.Item1)

# ---- group: Calculate n. of floors
division = Division(A=multiplication, B=area.Area)
round = Round(Number=division)  # -> Nearest, Floor, Ceiling
panel_6 = Panel(round.Floor)

# ---- group: Floor array
series = Series(Start=0, Step=floor_height, Count=round.Floor)

# ---- group: Visualization part 1
Z = UnitZ(Factor=series)
move = Move(Geometry=crv, Motion=Z)  # -> Geometry, Transform
Z_2 = UnitZ(Factor=floor_height)
extr = Extrude(Base=move.Geometry, Direction=Z_2)
boundary = BoundarySurfaces(Edges=move.Geometry)

# ---- group: Get the building height
addition = Addition(A=series, B=floor_height)  # -> reverse(Result)
item_3 = ListItem(List=addition, Index=0, Wrap=True)

# ---- group: Get the current FAR
multiplication_2 = Multiplication(A=area.Area, B=round.Floor)
division_2 = Division(A=multiplication_2, B=area_2.Area)

# ---- group: is the height less than max height of the land?
smaller = SmallerThan(FirstNumber=item_3, SecondNumber=item_2.Item2)  # -> SmallerThan, OrEqualTo

# ---- group: is the FAR less than max FAR of the land?
smaller_2 = SmallerThan(FirstNumber=division_2, SecondNumber=item_2.Item1)  # -> SmallerThan, OrEqualTo

# ----
and = GateAnd(A=smaller.OrEqualTo, B=smaller_2.OrEqualTo)

panel_7 = Panel(and)

# ---- group: Color property
filter_4 = StreamFilter(Gate=and, Stream0=ColourSwatch(SwatchColor=RGB(171, 94, 94)), Stream1=ColourSwatch(SwatchColor=RGB(132, 171, 94)))
preview_2 = CustomPreview(Geometry=boundary, Material=filter_4)
