# Grasshopper definition 04_plugin_oop_python.gh (Grasshopper 1.0.7)

# How to create a python plugin with Grasshopper
# part 4 - python oop
# 
# Focus on the object concept.
# 
# Idea:
# User moves the footprint of building upon different lands and it will be extruded automatically.
# Extrusion has to follow planning rules of the selected land, in particular the FAR of each land.
# 
# 
# Definitions:
# FAR = Floor area ratio (FAR) is the ratio of a building's total floor area
# (gross floor area) to the size of the piece of land upon which it is built. (Wikipedia)
# 
# 
# Requirements:
# Gismo for visualization
# ShrimpGIS
gismo = Gismo_Gismo(gismoFolder="c:\gismo")  # -> readMe; plug-in component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

# ---- group: Location
panel = Panel("Larino")
panel_2 = Panel("41.806148")
# This is part of PNL project by Antonello Di Nunzio
# 
# plugin@antonellodinunzio.online
panel_3 = Panel("14.9164668")

# ---- group: Visualize the context
osmobjects = Gismo_OSMObjects({"Building", "Commercial building", "Residential building", "Office building", "Office administrative", "Office government", "Post office", "Hospital", "Ambulance station", "Pharmacy"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}, selected="Building")
osmkeys = Gismo_OSMKeys(OSMobjectName=osmobjects)  # -> readMe, requiredKeys, OSMwebpage; inputs OSMobjectName: list; plug-in component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
createlocation = Gismo_CreateLocation(locationName=panel, latitude=panel_2, longitude=panel_3)  # -> location; plug-in component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
osmshapes = Gismo_OSMShapes(location=createlocation, radius="800", shapeType=0, requiredKeys=osmkeys.requiredKeys, bakeIt=False, runIt=Toggle(True))  # -> readMe, shapes, keys, values, port, titleOriginPt, title; inputs radius: Int32, origin: Point3d, shapeType: Int32, requiredKeys: list, onlyRemove_Ids: tree, bakeIt: Boolean, runIt: Boolean; plug-in component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

# ---- group: Create a ShrimpGIS location
shrimp_location = ShrimpGISLocation(name=panel, latitude=panel_2, longitude=panel_3)  # -> location; inputs anchor_point: Point3d; plug-in component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

# ---- group: Replace with a dir path where to save shp
python = GhPythonScript()  # -> geojson
# ---------- python: Python ----------
"""Get current path - for examples only"""

__author__ = "antonellodinunzio"

import os
file_name = ghenv.Component.OnPingDocument().FilePath
geojson = os.path.join(os.path.dirname(file_name), "geojson\\polygon.json")
# ---------- end python ----------

# ---- group: 1
toggle = BooleanToggle(True)

# ---- group: Read geojson
shrimp_read_geojson = ShrimpGISReadGeojson(geojson_file=python, location=shrimp_location, run_it=toggle)  # -> read_me, field, type, geometry; inputs run_it: Boolean; plug-in component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

# ----
flatten = FlattenTree(Tree=shrimp_read_geojson.geometry, Path="{0}")
# FAR = gross floor area / area of the plot
panel_4 = Panel(flatten)

# ---- group: Take only the first
item = ListItem(List=flatten, Index=0, Wrap=True)  # -> Item, Item1

# ---- group: Core
python_2 = GhPythonScript()  # -> out
# ---------- python_2: Python ----------
__author__ = "plugi"
__version__ = "2020.08.04"

# Modules here
import Rhino as rh
import scriptcontext as sc


class Building(object):
    
    def __init__(self, footprint, floor_height):
        
        self.footprint = footprint
        self.__floor_height = floor_height # I want this to be readonly!
        self.__area = rh.Geometry.AreaMassProperties.Compute(footprint).Area # I want this to be readonly!
    
    @property
    def floor_height(self):
        return self.__floor_height
    
    @property
    def area(self):
        return self.__area
    
    def ToString(self):
        return "Building::{}::{}".format(self.floor_height, self.area)

class Plot(object):
    
    tol = 0.01
    
    def __init__(self, geometry, far_limit, max_height):
        
        self.geometry = geometry
        self.__far_limit = far_limit # readonly
        self.__max_height = max_height # readonly
        self.__area = rh.Geometry.AreaMassProperties.Compute(geometry).Area # readonly
        self.__max_floor_area = self.far_limit * self.area
    
    @property
    def far_limit(self):
        return self.__far_limit
    
    @property
    def max_height(self):
        return self.__max_height
    
    @property
    def area(self):
        return self.__area
    
    @property
    def max_floor_area(self):
        return self.__max_floor_area
    
    def contain(self, building):
        return rh.Geometry.Intersect.Intersection.CurveBrep(building.footprint, self.geometry, self.tol)[1].Length > 0
    
    def ToString(self):
        return "Plot::{}::{}::{}".format(self.far_limit, self.max_height, self.area)

# Add my class to scriptcontext
sc.sticky["far_plugin_building"] = Building
sc.sticky["far_plugin_plot"] = Plot
# ---------- end python_2 ----------

# ----
crv = Curve(<curve referenced from the Rhino model>)

floor_height = Panel("3.2")
area = Area(Geometry=crv)  # -> Area, Centroid

max_height = Panel("18")
floor_height_2 = Panel("3.2")
# OOP
far_limit = Panel("2")
crv_2 = Curve(<curve referenced from the Rhino model>)

# ---- group: Building
python_3 = GhPythonScript(footprint=crv_2, floor_height=floor_height_2)  # -> out, building; inputs footprint: Curve
# ---------- python_3: Python ----------
__author__ = "plugi"
__version__ = "2020.08.04"

# Modules here
import scriptcontext as sc

# Retrive Building class from scriptcontext
Building = sc.sticky["far_plugin_building"]

building = Building(_footprint, _floor_height)
#print(isinstance(building, Building))

print(id(building))
# ---------- end python_3 ----------

# ---- group: Plot
python_4 = GhPythonScript(geometry=item.Item, far_limit=far_limit, max_height=max_height)  # -> out, plot; inputs geometry: Brep
# ---------- python_4: Python ----------
__author__ = "plugi"
__version__ = "2020.08.04"

# Modules here
import scriptcontext as sc

Plot = sc.sticky["far_plugin_plot"] 

# create an instace
plot = Plot(_geometry, _far_limit, _max_height)
# ---------- end python_4 ----------

# ---- group: Land A
bcx = BrepCurve(Brep=item.Item, Curve=crv)  # -> Curves, Points
max_height_2 = Panel("18")
far_limit_2 = Panel("2")
bool = Boolean(bcx.Curves)
merge = Merge(Data1=item.Item, Data2=far_limit_2, Data3=max_height_2)
filter = StreamFilter(Gate=bool, Stream1=merge)

# ----
bcx_2 = BrepCurve(Brep=item.Item1, Curve=crv)  # -> Curves, Points
far_limit_3 = Panel("1.5")
max_height_3 = Panel("19")
bool_2 = Boolean(bcx_2.Curves)
merge_2 = Merge(Data1=item.Item1, Data2=far_limit_3, Data3=max_height_3)
filter_2 = StreamFilter(Gate=bool_2, Stream1=merge_2)

panel_5 = Panel(python_4.plot)
panel_6 = Panel(python_3.building)

# ---- group: Magic
python_5 = GhPythonScript(plot=python_4.plot, building=python_3.building)  # -> out, floors, walls, check
# ---------- python_5: Python ----------
__author__ = "plugi"
__version__ = "2020.08.04"

# Modules here
import scriptcontext as sc
from math import floor
import Rhino as rh

Building = sc.sticky["far_plugin_building"]


def get_number_of_floor(plot, building):
    
    return int(floor(plot.max_floor_area / building.area))


def get_height_collection(number_of_floor, building):
    
    return [n * building.floor_height for n in range(number_of_floor)]


def get_floors(building, height_collection):
    
    floors = []
    
    for h in height_collection:
        
        geo = building.footprint.Duplicate()
        
        z_move = rh.Geometry.Transform.Translation(0, 0, h)
        geo.Transform(z_move)
        
        floors.append(geo)
    
    return floors


def get_walls(building, floors):
    
    walls = []
    
    for crv in floors:
        
        srf = rh.Geometry.Extrusion.CreateExtrusion(crv, rh.Geometry.Vector3d(0, 0, building.floor_height))
        walls.append(srf)
    
    return walls


# first check
is_building_upon_plot = _plot.contain(_building)

if is_building_upon_plot:
    
    # calculate number of floor
    number_of_floor = get_number_of_floor(_plot, _building)
    height_collection = get_height_collection(number_of_floor, _building)
    
    # move the footprint
    floors = get_floors(_building, height_collection)
    walls = get_walls(_building, floors)
    floors = [rh.Geometry.Brep.CreatePlanarBreps(crv, 0.01)[0] for crv in floors]
    
    # check if it is correct
    current_far = (_building.area * number_of_floor) / _plot.area
    current_height = height_collection[-1] + _building.floor_height
    
    check = (current_height < _plot.max_height) and (current_far < _plot.far_limit)
# ---------- end python_5 ----------

# ----
item_2 = ListItem(List=[filter, filter_2], Index=0, Wrap=True)  # -> Item, Item1, Item2
crv_3 = Curve(<curve referenced from the Rhino model>)
floor_height_3 = Panel("3.2")
far_limit_4 = Panel("2")
max_height_4 = Panel("18")
panel_7 = Panel(python_5.floors)
area_2 = Area(Geometry=item_2.Item)  # -> Area, Centroid
python_6 = GhPythonScript(land=item.Item, footprint=crv_3, floor_height=floor_height_3, far_limit=far_limit_4, max_height=max_height_4)  # -> out, floors, walls, check; inputs land: Brep, footprint: Curve
# ---------- python_6: Python ----------
__author__ = "plugi"
__version__ = "2020.08.03"

# Here I import main module to use
import Rhino as rh
import math

# LIMITS
# Only polygon without holes

# tolerance
tol = 0.01

"""
def function_here(n):
    return n * _floor_height
"""
def get_floor_to_visualize(floor_surface, height_collection):
    
    floors = []
    for h in height_collection:
        z_move = rh.Geometry.Transform.Translation(0, 0, h)
        floor = floor_surface.Duplicate()
        floor.Transform(z_move)
        floors.append(floor)
    
    return floors

def get_wiframe_building(height, floors):
    
    vector = rh.Geometry.Vector3d(0, 0, height)
    
    wireframe = []
    
    for f in floors:
        curve = rh.Geometry.Curve.JoinCurves(f.DuplicateEdgeCurves(True))[0]
        #rh.Geometry.Brep.DuplicateNakedEdgeCurves(
        wireframe.append(rh.Geometry.Surface.CreateExtrusion(curve, vector))
    
    return wireframe

def main():
    
    # footprint params
    footprint_area = rh.Geometry.AreaMassProperties.Compute(_footprint).Area
    
    # conditional statement to see if we can go ahead
    is_building_in_land = rh.Geometry.Intersect.Intersection.CurveBrep(_footprint, _land, tol)[1].Length > 0
    
    if (is_building_in_land):
        
        # calculate land area and max floor area you can build
        land_area = rh.Geometry.AreaMassProperties.Compute(_land).Area
        max_floor_area = land_area * _far_limit
        
        # how many floor?
        number_of_floor = int(math.floor(max_floor_area / footprint_area))
        
        #height_collection = map(function_here, range(number_of_floor))
        #height_collection = map(lambda n : n * _floor_height, range(number_of_floor))
        height_collection = [n * _floor_height for n in range(number_of_floor)]
        
        # visualization part
        floor_surface = rh.Geometry.Brep.CreatePlanarBreps(_footprint, tol)[0]
        
        floors = get_floor_to_visualize(floor_surface, height_collection)
        walls = get_wiframe_building(_floor_height, floors)
        
        # get the building height
        building_height = height_collection[-1] + _floor_height
        
        # get the current FAR
        current_far = (number_of_floor * footprint_area) / land_area
        
        # check
        check = (building_height <= _max_height) and (current_far <= _far_limit)
        
        return floors, walls, check
    return [None] * 3

if _land and _footprint and _floor_height and _far_limit and _max_height:
    floors, walls, check = main()
else:
    print("Please, connect all inputs")
# ---------- end python_6 ----------
multiplication = Multiplication(A=area_2.Area, B=item_2.Item1)

# ---- group: Calculate n. of floors
division = Division(A=multiplication, B=area.Area)
round = Round(Number=division)  # -> Nearest, Floor, Ceiling
panel_8 = Panel(round.Floor)

# ----
panel_9 = Panel(python_6.out)

# ---- group: Color property
filter_3 = StreamFilter(
    Gate=python_6.check,
    Stream0=ColourSwatch(SwatchColor=RGB(171, 94, 94)),
    Stream1=ColourSwatch(SwatchColor=RGB(132, 171, 94)))
preview = CustomPreview(Geometry=python_6.floors, Material=filter_3)

# ---- group: Floor array
series = Series(Start=0, Step=floor_height, Count=round.Floor)

# ---- group: Visualization part 1
Z = UnitZ(Factor=series)
move = Move(Geometry=crv, Motion=Z)  # -> Geometry, Transform
Z_2 = UnitZ(Factor=floor_height)
extr = Extrude(Base=move.Geometry, Direction=Z_2)
boundary = BoundarySurfaces(Edges=move.Geometry)

# ---- group: Get the building height
addition = Addition(A=series, B=floor_height)  # -> reverse(Result)
item_3 = ListItem(List=addition, Index=0, Wrap=True)

# ---- group: Get the current FAR
multiplication_2 = Multiplication(A=area.Area, B=round.Floor)
division_2 = Division(A=multiplication_2, B=area_2.Area)

# ---- group: is the height less than max height of the land?
smaller = SmallerThan(FirstNumber=item_3, SecondNumber=item_2.Item2)  # -> SmallerThan, OrEqualTo

# ---- group: is the FAR less than max FAR of the land?
smaller_2 = SmallerThan(FirstNumber=division_2, SecondNumber=item_2.Item1)  # -> SmallerThan, OrEqualTo

# ----
and = GateAnd(A=smaller.OrEqualTo, B=smaller_2.OrEqualTo)

panel_10 = Panel(and)

# ---- group: Color property
filter_4 = StreamFilter(Gate=and, Stream0=ColourSwatch(SwatchColor=RGB(171, 94, 94)), Stream1=ColourSwatch(SwatchColor=RGB(132, 171, 94)))
preview_2 = CustomPreview(Geometry=boundary, Material=filter_4)
