# Grasshopper definition 05_plugin_oop_python_complete.gh (Grasshopper 1.0.7)

# How to create a python plugin with Grasshopper
# part 5 - python oop
# 
# Focus on list of objects.
# 
# Idea:
# User moves the footprint of building upon different lands and it will be extruded automatically.
# Extrusion has to follow planning rules of the selected land, in particular the FAR of each land.
# 
# 
# Definitions:
# FAR = Floor area ratio (FAR) is the ratio of a building's total floor area
# (gross floor area) to the size of the piece of land upon which it is built. (Wikipedia)
# 
# 
# Requirements:
# Gismo for visualization
# ShrimpGIS
gismo = Gismo_Gismo(gismoFolder="c:\gismo")  # -> readMe; plug-in component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

# ---- group: Location
panel = Panel("Larino")
panel_2 = Panel("41.806148")
# This is part of PNL project by Antonello Di Nunzio
# 
# plugin@antonellodinunzio.online
panel_3 = Panel("14.9164668")

# ---- group: Visualize the context
osmobjects = Gismo_OSMObjects({"Building", "Commercial building", "Residential building", "Office building", "Office administrative", "Office government", "Post office", "Hospital", "Ambulance station", "Pharmacy"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}, selected="Building")
osmkeys = Gismo_OSMKeys(OSMobjectName=osmobjects)  # -> readMe, requiredKeys, OSMwebpage; inputs OSMobjectName: list; plug-in component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
createlocation = Gismo_CreateLocation(locationName=panel, latitude=panel_2, longitude=panel_3)  # -> location; plug-in component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
osmshapes = Gismo_OSMShapes(location=createlocation, radius="800", shapeType=0, requiredKeys=osmkeys.requiredKeys, bakeIt=False, runIt=Toggle(True))  # -> readMe, shapes, keys, values, port, titleOriginPt, title; inputs radius: Int32, origin: Point3d, shapeType: Int32, requiredKeys: list, onlyRemove_Ids: tree, bakeIt: Boolean, runIt: Boolean; plug-in component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

# ---- group: Create a ShrimpGIS location
shrimp_location = ShrimpGISLocation(name=panel, latitude=panel_2, longitude=panel_3)  # -> location; inputs anchor_point: Point3d; plug-in component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

# ---- group: Replace with a dir path where to save shp
python = GhPythonScript()  # -> geojson
# ---------- python: Python ----------
"""Get current path - for examples only"""

__author__ = "antonellodinunzio"

import os
file_name = ghenv.Component.OnPingDocument().FilePath
geojson = os.path.join(os.path.dirname(file_name), "geojson\\land.json")
# ---------- end python ----------

# ---- group: 1
toggle = BooleanToggle(True)

# ---- group: Read geojson
shrimp_read_geojson = ShrimpGISReadGeojson(geojson_file=python, location=shrimp_location, run_it=toggle)  # -> read_me, field, type, geometry; inputs run_it: Boolean; plug-in component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

# ----
flatten = FlattenTree(Tree=shrimp_read_geojson.geometry, Path="{0}")
panel_4 = Panel(flatten)

# ---- group: Get FAR and heights
shrimp_dec_field = ShrimpGISDecomposeField(field=shrimp_read_geojson.field)  # -> read_me, name, values; inputs field: list; plug-in component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
bang = ExplodeTree(Data=shrimp_dec_field.values)  # -> Branch0, Branch1

# ---- group: Labels
area = Area(Geometry=flatten)  # -> Area, Centroid
tag = TextTag(Location=area.Centroid, Text=bang.Branch0, Colour=ColourSwatch(SwatchColor=RGB(0, 0, 0)))

# ----
# FAR = gross floor area / area of the plot
far_core = PNLFARCore()  # -> out
# ---------- far_core: Python ----------
"""Core of PNL plugin example.
-
This resource is part of PNL project, see GitHub: ...
    Output:
        out: Message for the user."""

__author__ = "plugin@antonellodinunzio.online"
__version__ = "2020.08.04"
__license__ = "GNU GPL V.3"

ghenv.Component.Name = "PNL FAR Core"
ghenv.Component.NickName = "far_core"

# Modules here
import Rhino as rh
import scriptcontext as sc
from math import floor


class Building(object):
    
    def __init__(self, footprint, floor_height):
        
        self.footprint = footprint
        self.__floor_height = floor_height # I want this to be readonly!
        self.__area = rh.Geometry.AreaMassProperties.Compute(footprint).Area # I want this to be readonly!
    
    @property
    def floor_height(self):
        return self.__floor_height
    
    @property
    def area(self):
        return self.__area
    
    def ToString(self):
        return "Building::{}::{}".format(self.floor_height, self.area)

class Plot(object):
    
    tol = 0.01
    
    def __init__(self, geometry, far_limit, max_height):
        
        self.geometry = geometry
        self.__far_limit = far_limit # readonly
        self.__max_height = max_height # readonly
        self.__area = rh.Geometry.AreaMassProperties.Compute(geometry).Area # readonly
        self.__max_floor_area = self.far_limit * self.area
    
    @property
    def far_limit(self):
        return self.__far_limit
    
    @property
    def max_height(self):
        return self.__max_height
    
    @property
    def area(self):
        return self.__area
    
    @property
    def max_floor_area(self):
        return self.__max_floor_area
    
    def contain(self, building):
        return rh.Geometry.Intersect.Intersection.CurveBrep(building.footprint, self.geometry, self.tol)[1].Length > 0
    
    def ToString(self):
        return "Plot::{}::{}::{}".format(self.far_limit, self.max_height, self.area)


class City:
    
    def get_number_of_floor(self, land, building):
        return int(floor(land.max_floor_area / building.area))
    
    def get_height_collection(self, number_of_floor, building):
        return [n * building.floor_height for n in range(number_of_floor)]
    
    def get_floors(self, building, height_collection):
        
        floors = []
        
        for h in height_collection:
            
            geo = building.footprint.Duplicate()
            
            z_move = rh.Geometry.Transform.Translation(0, 0, h)
            geo.Transform(z_move)
            
            floors.append(geo)
        
        return floors
    
    def get_walls(self, building, floors):
        
        walls = []
        
        for crv in floors:
            
            srf = rh.Geometry.Extrusion.CreateExtrusion(crv, rh.Geometry.Vector3d(0, 0, building.floor_height))
            walls.append(srf)
        
        return walls


# Add my class to scriptcontext
sc.sticky["far_plugin_building"] = Building
sc.sticky["far_plugin_plot"] = Plot
sc.sticky["far_plugin_city"] = City

print("Core is running...")
# ---------- end far_core ----------
panel_5 = Panel(far_core)

# ---- group: Create the Building
floor_height = Panel("3")
crv = Curve(<curve referenced from the Rhino model>)
far_building = PNLFARBuilding(footprint=crv, floor_height=floor_height)  # -> out, building; inputs footprint: Curve
# ---------- far_building: Python ----------
"""
This component create a building object.
-
Limit - only a planar closed curve is supported.
-
This resource is part of PNL project, see GitHub: ...
    Inputs:
        _footprint: Connect a closed curve [Item].
        _floor_height: Height of floor in meter. Connect a float [Item].
    Output:
        building: Building object <Land::floor height::area>.
        out: Messages for users.
"""

__author__ = "plugin@antonellodinunzio.online"
__version__ = "2020.08.04"
__license__ = "GNU GPL V.3"

ghenv.Component.Name = "PNL FAR Building"
ghenv.Component.NickName = "far_building"

# Modules here
import scriptcontext as sc

# Retrive Building class from scriptcontext
Building = sc.sticky["far_plugin_building"]

building = Building(_footprint, _floor_height)
#print(isinstance(building, Building))

print(id(building))
# ---------- end far_building ----------

# ---- group: Create Plot
far_plot = PNLFARPlot(geometry=flatten, far_limit=bang.Branch0, max_height=bang.Branch1)  # -> out, plot; inputs geometry: list of Brep, far_limit: list, max_height: list
# ---------- far_plot: Python ----------
"""
This component create land objects.
-
This resource is part of PNL project, see GitHub: ...
    Inputs:
        _geometry: Connect a list of planar surface [List].
        _far_limit: FAR of the plot. Connect a list of float [List].
        _max_height: Max height of a building upon the plot. Connect a list of float [List].
    Output:
        plot: Land objects <Land::FAR::max height::area>.
        out: Messages for users.
"""

__author__ = "plugin@antonellodinunzio.online"
__version__ = "2020.08.04"
__license__ = "GNU GPL V.3"

ghenv.Component.Name = "PNL FAR Plot"
ghenv.Component.NickName = "far_plot"

# Modules here
import scriptcontext as sc

Plot = sc.sticky["far_plugin_plot"] 

# create many instaces
plot = [Plot(geometry, far, height) for geometry, far, height in zip(_geometry, _far_limit, _max_height)]
# ---------- end far_plot ----------

# ----
panel_6 = Panel(far_building.building)
panel_7 = Panel(far_plot.plot)

# ---- group: Calculate floors and check the FAR
far_calculator = PNLFARCalculator(plot=far_plot.plot, building=far_building.building)  # -> out, floors, walls, check; inputs plot: list
# ---------- far_calculator: Python ----------
"""This component generates floors using plot parameters.
-
This resource is part of PNL project, see GitHub: ...
    Inputs:
        _plot: Connect a list of plot objects to test [List].
        _building: Connect a building object [Item].
    Output:
        out: Messages for the user.
        floors: Floors of the building.
        walls: Walls of the building.
        check: Are FAR and max height Ok?
"""

__author__ = "plugin@antonellodinunzio.online"
__version__ = "2020.08.04"
__license__ = "GNU GPL V.3"

ghenv.Component.Name = "PNL FAR Calculator"
ghenv.Component.NickName = "far_calculator"

# Modules here
import scriptcontext as sc
from math import floor
import Rhino as rh

Building = sc.sticky["far_plugin_building"]
City = sc.sticky["far_plugin_city"]

def main():
    
    city = City()
    
    for plot in _plot:
        # first check
        is_building_upon_plot = plot.contain(_building)
        
        if is_building_upon_plot:
            
            # calculate number of floor
            number_of_floor = city.get_number_of_floor(plot, _building)
            height_collection = city.get_height_collection(number_of_floor, _building)
            
            # move the footprint
            floors = city.get_floors(_building, height_collection)
            walls = city.get_walls(_building, floors)
            # just for visualization
            floors = [rh.Geometry.Brep.CreatePlanarBreps(crv, 0.01)[0] for crv in floors]
            
            # check if it is correct
            current_far = (_building.area * number_of_floor) / plot.area
            current_height = height_collection[-1] + _building.floor_height
            
            check = (current_height < plot.max_height) and (current_far < plot.far_limit)
            
            return floors, walls, check
        else:
            continue

if (_plot and _building):
    floors, walls, check = main()
else:
    print("Please, connect _plot and building")
# ---------- end far_calculator ----------

# ----
srf = Surface(far_calculator.walls)
panel_8 = Panel(far_calculator.out)

# ---- group: Color property
filter = StreamFilter(
    Gate=far_calculator.check,
    Stream0=ColourSwatch(SwatchColor=RGB(171, 94, 94)),
    Stream1=ColourSwatch(SwatchColor=RGB(132, 171, 94)))
preview = CustomPreview(Geometry=far_calculator.floors, Material=filter)
